# Grasshopper definition example.gh (Grasshopper 1.0.7)
# plug-ins: Kangaroo2 Components, MeshQuadrangulation

conmesh = ConstructMesh(Vertices=[Point(0, 0, 0), Point(10, 0, 0), Point(10, 10, 0), Point(0, 10, 0)], Faces={A=0, B=1, C=2, D=3})
triremesh = TriRemesh(Geometry=conmesh, Length=Slider(1.04, range=0..3), Iterations=25)  # -> Triangulation, Dual, Creases
demesh = DeconstructMesh(Mesh=conmesh)  # -> Vertices, Faces, Colours, Normals
pt = Point(demesh.Vertices)
m_quadr = MeshQuadrangulation(Mesh=triremesh.Triangulation, Sources=Slider(65, range=0..100))
catmull = CatmullClark(Mesh=m_quadr, Iterations=1, FixedVertices=pt)
nv = NakedVertices(Mesh=catmull)  # -> ClothedIndex, NakedIndex, ClothedPts, NakedPts
